# Dynamo graph Lab 1 - Parametric Surface.dyn (Dynamo 2.4.0.6186)

# group: LAB 1 - Generating a parametric Surface
code_block = CodeBlock { 0; 10; 20; 30; }
A = DoubleSlider(1.1, range=0..3 step 0.1)  # graph input
byCoordinates = Point.ByCoordinates(y=code_block.out0, z=A)
B = DoubleSlider(2, range=0..3 step 0.1)  # graph input
byCoordinates_2 = Point.ByCoordinates(y=code_block.out1, z=B)
C = DoubleSlider(2, range=0..3 step 0.1)  # graph input
byCoordinates_3 = Point.ByCoordinates(y=code_block.out2, z=C)
D = DoubleSlider(3, range=0..3 step 0.1)  # graph input
byCoordinates_4 = Point.ByCoordinates(y=code_block.out3, z=D)
list_create = List.Create(item0=byCoordinates, item1=byCoordinates_2, item2=byCoordinates_3, item3=byCoordinates_4)
byControlPoints = NurbsCurve.ByControlPoints(points=list_create)
code_block_2 = CodeBlock { 15; }
code_block_3 = CodeBlock { 0; 10; 20; 30; }
AAAA = DoubleSlider(0.7, range=0..6 step 0.1)  # graph input
byCoordinates_5 = Point.ByCoordinates(x=code_block_2, y=code_block_3.out0, z=AAAA)
BBB = DoubleSlider(0.7, range=0..6 step 0.1)  # graph input
byCoordinates_6 = Point.ByCoordinates(x=code_block_2, y=code_block_3.out1, z=BBB)
CCC = DoubleSlider(0, range=0..6 step 0.1)  # graph input
byCoordinates_7 = Point.ByCoordinates(x=code_block_2, y=code_block_3.out2, z=CCC)
DDD = DoubleSlider(0.4, range=0..6 step 0.1)  # graph input
byCoordinates_8 = Point.ByCoordinates(x=code_block_2, y=code_block_3.out3, z=DDD)
list_create_2 = List.Create(item0=byCoordinates_5, item1=byCoordinates_6, item2=byCoordinates_7, item3=byCoordinates_8)
byControlPoints_2 = NurbsCurve.ByControlPoints(points=list_create_2)
code_block_4 = CodeBlock { 30; }
code_block_5 = CodeBlock { 0; 10; 20; 30; }
number_slider = DoubleSlider(1.4, range=0..3 step 0.1)
byCoordinates_9 = Point.ByCoordinates(x=code_block_4, y=code_block_5.out0, z=number_slider)
number_slider_2 = DoubleSlider(1, range=0..3 step 0.1)
byCoordinates_10 = Point.ByCoordinates(x=code_block_4, y=code_block_5.out1, z=number_slider_2)
number_slider_3 = DoubleSlider(0, range=0..3 step 0.1)
byCoordinates_11 = Point.ByCoordinates(x=code_block_4, y=code_block_5.out2, z=number_slider_3)
number_slider_4 = DoubleSlider(0.7, range=0..3 step 0.1)
byCoordinates_12 = Point.ByCoordinates(x=code_block_4, y=code_block_5.out3, z=number_slider_4)
list_create_3 = List.Create(item0=byCoordinates_9, item1=byCoordinates_10, item2=byCoordinates_11, item3=byCoordinates_12)
byControlPoints_3 = NurbsCurve.ByControlPoints(points=list_create_3)
list_create_4 = List.Create(item0=byControlPoints, item1=byControlPoints_2, item2=byControlPoints_3)
byLoft = Surface.ByLoft(crossSections=list_create_4)
