# Dynamo graph Lab 2 - Parametric Structure.dyn (Dynamo 2.4.0.6186)
# packages: Data-Shapes 2019.2.33

# group: LAB 1
code_block = CodeBlock { 0; 10; 20; 30; }
A = DoubleSlider(1.1, range=0..3 step 0.1)  # graph input
byCoordinates = Point.ByCoordinates(y=code_block.out0, z=A)
B = DoubleSlider(2, range=0..3 step 0.1)  # graph input
byCoordinates_2 = Point.ByCoordinates(y=code_block.out1, z=B)
C = DoubleSlider(2, range=0..3 step 0.1)  # graph input
byCoordinates_3 = Point.ByCoordinates(y=code_block.out2, z=C)
D = DoubleSlider(3, range=0..3 step 0.1)  # graph input
byCoordinates_4 = Point.ByCoordinates(y=code_block.out3, z=D)
list_create = List.Create(item0=byCoordinates, item1=byCoordinates_2, item2=byCoordinates_3, item3=byCoordinates_4)
byControlPoints = NurbsCurve.ByControlPoints(points=list_create)
code_block_2 = CodeBlock { 15; }
code_block_3 = CodeBlock { 0; 10; 20; 30; }
AAAA = DoubleSlider(6, range=0..6 step 0.1)  # graph input
byCoordinates_5 = Point.ByCoordinates(x=code_block_2, y=code_block_3.out0, z=AAAA)
BBB = DoubleSlider(3.2, range=0..6 step 0.1)  # graph input
byCoordinates_6 = Point.ByCoordinates(x=code_block_2, y=code_block_3.out1, z=BBB)
CCC = DoubleSlider(0, range=0..6 step 0.1)  # graph input
byCoordinates_7 = Point.ByCoordinates(x=code_block_2, y=code_block_3.out2, z=CCC)
DDD = DoubleSlider(2.4, range=0..6 step 0.1)  # graph input
byCoordinates_8 = Point.ByCoordinates(x=code_block_2, y=code_block_3.out3, z=DDD)
list_create_2 = List.Create(item0=byCoordinates_5, item1=byCoordinates_6, item2=byCoordinates_7, item3=byCoordinates_8)
byControlPoints_2 = NurbsCurve.ByControlPoints(points=list_create_2)
code_block_4 = CodeBlock { 30; }
code_block_5 = CodeBlock { 0; 10; 20; 30; }
number_slider = DoubleSlider(1.4, range=0..3 step 0.1)
byCoordinates_9 = Point.ByCoordinates(x=code_block_4, y=code_block_5.out0, z=number_slider)
number_slider_2 = DoubleSlider(1, range=0..3 step 0.1)
byCoordinates_10 = Point.ByCoordinates(x=code_block_4, y=code_block_5.out1, z=number_slider_2)
number_slider_3 = DoubleSlider(0, range=0..3 step 0.1)
byCoordinates_11 = Point.ByCoordinates(x=code_block_4, y=code_block_5.out2, z=number_slider_3)
number_slider_4 = DoubleSlider(0.7, range=0..3 step 0.1)
byCoordinates_12 = Point.ByCoordinates(x=code_block_4, y=code_block_5.out3, z=number_slider_4)
list_create_3 = List.Create(item0=byCoordinates_9, item1=byCoordinates_10, item2=byCoordinates_11, item3=byCoordinates_12)
byControlPoints_3 = NurbsCurve.ByControlPoints(points=list_create_3)
list_create_4 = List.Create(item0=byControlPoints, item1=byControlPoints_2, item2=byControlPoints_3)
byLoft = Surface.ByLoft(crossSections=list_create_4)

# group: Points Grid On Surface
code_block_6 = CodeBlock { 0; 1; 0.1; }
range = Range(start=code_block_6.out0, end=code_block_6.out1, step=code_block_6.out2)
pointAtParameter = Surface.PointAtParameter(surface=byLoft, u=range, v=range, lacing=CrossProduct)
code_block_7 = CodeBlock { 0; 1; 1; }
range_2 = Range(start=code_block_7.out0, end=code_block_7.out1, step=code_block_7.out2)
code_block_8 = CodeBlock { 1; }

# group: 1 - Vertical Supports
normalAtPoint = Surface.NormalAtPoint(surface=byLoft, point=pointAtParameter)
number_slider_5 = DoubleSlider(2.6, range=0..3 step 0.1)
translate = Geometry.Translate(geometry=pointAtParameter, direction=normalAtPoint, distance=number_slider_5)
byStartPointEndPoint = Line.ByStartPointEndPoint(startPoint=pointAtParameter, endPoint=translate)

# group: 2 - Longitudinal Supports - top face
transpose = List.Transpose(lists=pointAtParameter)
byPoints = PolyCurve.ByPoints(points=transpose)
curves = PolyCurve.Curves(polyCurve=byPoints)
byPoints_2 = PolyCurve.ByPoints(points=pointAtParameter)
curves_2 = PolyCurve.Curves(polyCurve=byPoints_2)

# group: 3 - Longitudinal Supports - bottom face
byPoints_3 = PolyCurve.ByPoints(points=translate)
curves_3 = PolyCurve.Curves(polyCurve=byPoints_3)
transpose_2 = List.Transpose(lists=translate)
byPoints_4 = PolyCurve.ByPoints(points=transpose_2)
curves_4 = PolyCurve.Curves(polyCurve=byPoints_4)

# group: Arranging points as quads
sublists = List.Sublists(list=pointAtParameter, ranges=range_2, offset=code_block_8)
count = List.Count(list=range)
code_block_9 = CodeBlock(count=count) { count-1; }
takeItems = List.TakeItems(list=sublists, amount=code_block_9)
transpose_3 = List.Transpose(lists=takeItems@L3)
sublists_2 = List.Sublists(list=transpose_3@L3, ranges=range_2, offset=code_block_8)
takeItems_2 = List.TakeItems(list=sublists_2@L4, amount=code_block_9)
flatten = List.Flatten(list=takeItems_2@L3)

# group: 4 - Cross supports - top face
code_block_10 = CodeBlock { 0; 3; }
getItemAtIndex = List.GetItemAtIndex(list=flatten@L2, index=code_block_10.out0)
getItemAtIndex_2 = List.GetItemAtIndex(list=flatten@L2, index=code_block_10.out1)
byStartPointEndPoint_2 = Line.ByStartPointEndPoint(startPoint=getItemAtIndex, endPoint=getItemAtIndex_2)

# group: 5 - Cross supports - bottom face
normalAtPoint_2 = Surface.NormalAtPoint(surface=byLoft, point=flatten)
translate_2 = Geometry.Translate(geometry=flatten, direction=normalAtPoint_2, distance=number_slider_5)
code_block_11 = CodeBlock { 0; 3; }
getItemAtIndex_3 = List.GetItemAtIndex(list=translate_2@L2, index=code_block_11.out0)
getItemAtIndex_4 = List.GetItemAtIndex(list=translate_2@L2, index=code_block_11.out1)
byStartPointEndPoint_3 = Line.ByStartPointEndPoint(startPoint=getItemAtIndex_3, endPoint=getItemAtIndex_4)

# group: 6 - Cross supports - vertical
code_block_12 = CodeBlock { 2; }
getItemAtIndex_5 = List.GetItemAtIndex(list=translate_2@L2, index=code_block_12)
byStartPointEndPoint_4 = Line.ByStartPointEndPoint(startPoint=getItemAtIndex, endPoint=getItemAtIndex_5)

geomPreview = GeomPreviewNodeModel(Geometry=byLoft, SliderValue=127.42, rValue="255", gValue="253", bValue="94")
