# Dynamo graph Lab 3 - Physics simulation and generative study-refinery.dyn (Dynamo 2.4.0.6186)
# packages: Data-Shapes 2019.2.33, DynaShape 0.6.0, Refinery 0.35.0

# group: LAB 1
code_block = CodeBlock { 0; 10; 20; 30; }
A = DoubleSlider(0, range=0..3 step 0.1)  # graph input
byCoordinates = Point.ByCoordinates(y=code_block.out0, z=A)
B = DoubleSlider(0, range=0..3 step 0.1)  # graph input
byCoordinates_2 = Point.ByCoordinates(y=code_block.out1, z=B)
C = DoubleSlider(0.1, range=0..3 step 0.1)  # graph input
byCoordinates_3 = Point.ByCoordinates(y=code_block.out2, z=C)
D = DoubleSlider(0, range=0..3 step 0.1)  # graph input
byCoordinates_4 = Point.ByCoordinates(y=code_block.out3, z=D)
list_create = List.Create(item0=byCoordinates, item1=byCoordinates_2, item2=byCoordinates_3, item3=byCoordinates_4)
byControlPoints = NurbsCurve.ByControlPoints(points=list_create)
code_block_2 = CodeBlock { 15; }
code_block_3 = CodeBlock { 0; 10; 20; 30; }
AAAA = DoubleSlider(6, range=0..6 step 0.1)  # graph input
byCoordinates_5 = Point.ByCoordinates(x=code_block_2, y=code_block_3.out0, z=AAAA)
BBB = DoubleSlider(6, range=0..6 step 0.1)  # graph input
byCoordinates_6 = Point.ByCoordinates(x=code_block_2, y=code_block_3.out1, z=BBB)
CCC = DoubleSlider(6, range=0..6 step 0.1)  # graph input
byCoordinates_7 = Point.ByCoordinates(x=code_block_2, y=code_block_3.out2, z=CCC)
DDD = DoubleSlider(6, range=0..6 step 0.1)  # graph input
byCoordinates_8 = Point.ByCoordinates(x=code_block_2, y=code_block_3.out3, z=DDD)
list_create_2 = List.Create(item0=byCoordinates_5, item1=byCoordinates_6, item2=byCoordinates_7, item3=byCoordinates_8)
byControlPoints_2 = NurbsCurve.ByControlPoints(points=list_create_2)
code_block_4 = CodeBlock { 30; }
code_block_5 = CodeBlock { 0; 10; 20; 30; }
E = DoubleSlider(0, range=0..3 step 0.1)  # graph input
byCoordinates_9 = Point.ByCoordinates(x=code_block_4, y=code_block_5.out0, z=E)
F = DoubleSlider(0, range=0..3 step 0.1)  # graph input
byCoordinates_10 = Point.ByCoordinates(x=code_block_4, y=code_block_5.out1, z=F)
G = DoubleSlider(0, range=0..3 step 0.1)  # graph input
byCoordinates_11 = Point.ByCoordinates(x=code_block_4, y=code_block_5.out2, z=G)
H = DoubleSlider(0, range=0..3 step 0.1)  # graph input
byCoordinates_12 = Point.ByCoordinates(x=code_block_4, y=code_block_5.out3, z=H)
list_create_3 = List.Create(item0=byCoordinates_9, item1=byCoordinates_10, item2=byCoordinates_11, item3=byCoordinates_12)
byControlPoints_3 = NurbsCurve.ByControlPoints(points=list_create_3)
list_create_4 = List.Create(item0=byControlPoints, item1=byControlPoints_2, item2=byControlPoints_3)
byLoft = Surface.ByLoft(crossSections=list_create_4)

geomPreview = GeomPreviewNodeModel(Geometry=byLoft, SliderValue=127.42, rValue="245", gValue="255", bValue="94")
code_block_6 = CodeBlock()
# ---------- code_block_6.designscript (6 lines) ----------
def curveToLine(inputcurve)
{
startpoint = inputcurve.StartPoint;
endpoint = inputcurve.EndPoint;
return = Line.ByStartPointEndPoint(startpoint,endpoint);
};
# ----------------------------------------
create = DynaShape.ZeroTouch.Solver.Create()

# group: Points Grid On Surface
code_block_7 = CodeBlock { 0; 1; 0.1; }
range = Range(start=code_block_7.out0, end=code_block_7.out1, step=code_block_7.out2)
pointAtParameter = Surface.PointAtParameter(surface=byLoft, u=range, v=range, lacing=CrossProduct)
code_block_8 = CodeBlock { 0; 1; 1; }
range_2 = Range(start=code_block_8.out0, end=code_block_8.out1, step=code_block_8.out2)
code_block_9 = CodeBlock { 1; }

# group: 2 - Longitudinal Supports - top face
transpose = List.Transpose(lists=pointAtParameter)
byPoints = PolyCurve.ByPoints(points=transpose)
curves = PolyCurve.Curves(polyCurve=byPoints)
byPoints_2 = PolyCurve.ByPoints(points=pointAtParameter)
curves_2 = PolyCurve.Curves(polyCurve=byPoints_2)

space_frame_depth = DoubleSlider(2.6, range=0..3 step 0.1)  # graph input

# group: 1 - Vertical Supports
normalAtPoint = Surface.NormalAtPoint(surface=byLoft, point=pointAtParameter)
translate = Geometry.Translate(geometry=pointAtParameter, direction=normalAtPoint, distance=space_frame_depth)
byStartPointEndPoint = Line.ByStartPointEndPoint(startPoint=pointAtParameter, endPoint=translate)

# group: 3 - Longitudinal Supports - bottom face
transpose_2 = List.Transpose(lists=translate)
byPoints_3 = PolyCurve.ByPoints(points=translate)
curves_3 = PolyCurve.Curves(polyCurve=byPoints_3)
byPoints_4 = PolyCurve.ByPoints(points=transpose_2)
curves_4 = PolyCurve.Curves(polyCurve=byPoints_4)

# group: Setting up anchor goal
# note: Specifying supporting elements
firstItem = List.FirstItem(list=transpose)
firstItem_2 = List.FirstItem(list=transpose_2)
list_create_5 = List.Create(item0=firstItem, item1=firstItem_2)
flatten = List.Flatten(list=list_create_5)
code_block_10 = CodeBlock { 1000000; }
anchorGoal_Create = DynaShape.ZeroTouch.Goals.AnchorGoal_Create(startPosition=flatten, anchor=flatten, weight=code_block_10)

code_block_11 = CodeBlock(c=curves) { curveToLine(c); }
code_block_12 = CodeBlock(c=curves_3) { curveToLine(c); }
code_block_13 = CodeBlock(c=curves_4) { curveToLine(c); }

# group: Arranging points as quads
sublists = List.Sublists(list=pointAtParameter, ranges=range_2, offset=code_block_9)
count = List.Count(list=range)
code_block_14 = CodeBlock(count=count) { count-1; }
takeItems = List.TakeItems(list=sublists, amount=code_block_14)
transpose_3 = List.Transpose(lists=takeItems@L3)
sublists_2 = List.Sublists(list=transpose_3@L3, ranges=range_2, offset=code_block_9)
takeItems_2 = List.TakeItems(list=sublists_2@L4, amount=code_block_14)
flatten_2 = List.Flatten(list=takeItems_2@L3)

# group: 4 - Cross supports - top face
code_block_15 = CodeBlock { 0; 3; }
getItemAtIndex = List.GetItemAtIndex(list=flatten_2@L2, index=code_block_15.out0)
getItemAtIndex_2 = List.GetItemAtIndex(list=flatten_2@L2, index=code_block_15.out1)
byStartPointEndPoint_2 = Line.ByStartPointEndPoint(startPoint=getItemAtIndex, endPoint=getItemAtIndex_2)

# group: 5 - Cross supports - bottom face
normalAtPoint_2 = Surface.NormalAtPoint(surface=byLoft, point=flatten_2)
translate_2 = Geometry.Translate(geometry=flatten_2, direction=normalAtPoint_2, distance=space_frame_depth)
code_block_16 = CodeBlock { 0; 3; }
getItemAtIndex_3 = List.GetItemAtIndex(list=translate_2@L2, index=code_block_16.out0)
getItemAtIndex_4 = List.GetItemAtIndex(list=translate_2@L2, index=code_block_16.out1)
byStartPointEndPoint_3 = Line.ByStartPointEndPoint(startPoint=getItemAtIndex_3, endPoint=getItemAtIndex_4)

# group: 6 - Cross supports - vertical
code_block_17 = CodeBlock { 2; }
getItemAtIndex_5 = List.GetItemAtIndex(list=translate_2@L2, index=code_block_17)
byStartPointEndPoint_4 = Line.ByStartPointEndPoint(startPoint=getItemAtIndex, endPoint=getItemAtIndex_5)

code_block_18 = CodeBlock(c=curves_2) { curveToLine(c); }

# group: 6 - Cross supports - vertical
byStartPointEndPoint_5 = Line.ByStartPointEndPoint(startPoint=getItemAtIndex, endPoint=getItemAtIndex_4)

# group: Setting up length goal
# note: Making sure the length of the lines (structural elements) doesnt get too stretched out
list_create_6 = List.Create(item0=byStartPointEndPoint, item1=code_block_11, item2=code_block_12, item3=code_block_13, item4=byStartPointEndPoint_2, item5=byStartPointEndPoint_3, item6=byStartPointEndPoint_4, item7=code_block_18, item8=byStartPointEndPoint_5)
flatten_3 = List.Flatten(list=list_create_6)
length = Curve.Length(curve=flatten_3)
code_block_19 = CodeBlock { 500000; }
lengthGoal_Create = DynaShape.ZeroTouch.Goals.LengthGoal_Create(line=flatten_3, targetLength=length, weight=code_block_19)

sum = Math.Sum(values=length)

# group: Setting up weight on top surface
flatten_4 = List.Flatten(list=pointAtParameter)
code_block_20 = CodeBlock()
# ---------- code_block_20.designscript (5 lines) ----------
//Beam linear weight (kg/m)
20;

//Surface Area of pannels (kg/m²)
80;
# ----------------------------------------
count_2 = List.Count(list=flatten_4)
area = Surface.Area(surface=byLoft)
code_block_21 = CodeBlock(totalCUrveLength=sum, beamLinearWeight=code_block_20.out0, numberOfKnots=count_2, totalArea=area, pannelSurfaceWeight=code_block_20.out1) { totalCUrveLength * beamLinearWeight / numberOfKnots; totalArea * pannelSurfaceWeight / numberOfKnots; }
code_block_22 = CodeBlock(a=code_block_21.out0, b=code_block_21.out1) { -(a+b); }
byCoordinates_13 = Vector.ByCoordinates(z=code_block_22)
constantGoal_Create = DynaShape.ZeroTouch.Goals.ConstantGoal_Create(startPositions=flatten_4, constant=byCoordinates_13)

# group: List of goals - MUST BE FLAT
list_create_7 = List.Create(item0=anchorGoal_Create, item1=lengthGoal_Create, item2=constantGoal_Create)
flatten_5 = List.Flatten(list=list_create_7)

# group: Geometry Binders
byArgbUI = ByArgbUINodeModel(SliderValue=255, rValue="255", gValue="47", bValue="67")  # "UI.Color.ByArgbUI"
lineBinder = DynaShape.ZeroTouch.GeometryBinders.LineBinder(line=flatten_3, color=byArgbUI)

code_block_23 = CodeBlock { 3000; }
boolean = BoolSelector(false)
boolean_2 = BoolSelector(true)
execute = DynaShape.ZeroTouch.Solver.Execute(solver=create, goals=flatten_5, geometryBinders=lineBinder, iterations=code_block_23, reset=boolean, execute=boolean_2, enableMomentum=boolean_2, enableFastDisplay=boolean_2, enableManipulation=boolean_2)  # frozen
code_block_24 = CodeBlock { 3000; 1.0e-10; }
boolean_3 = BoolSelector(true)
executeSilently = DynaShape.ZeroTouch.Solver.ExecuteSilently(goals=flatten_5, geometryBinders=lineBinder, iterations=code_block_24.out0, terminationThreshold=code_block_24.out1, execute=boolean_3, enableMomentum=boolean_3)
geomPreview_2 = GeomPreviewNodeModel(Geometry=executeSilently.geometries, SliderValue=155.6, rValue="255", gValue="93", bValue="94")
remember = Data.Remember(executeSilently.nodePositions)
remember_2 = Data.Remember(executeSilently.geometries)

# group: Generative process - values of interest
flatten_6 = List.Flatten(list=remember)
distanceTo = Geometry.DistanceTo(geometry=flatten_6, other=byLoft)
maximum_deflection = List.MaximumItem(list=distanceTo)
surface_area = Surface.Area(surface=byLoft)
flatten_7 = List.Flatten(list=remember_2)
length_2 = Curve.Length(curve=flatten_7)
code_block_25 = CodeBlock(a=length, b=length_2) { a-b; }
maximum_stretch = List.MaximumItem(list=code_block_25)

max_deflection = Watch(maximum_deflection)  # graph output
surf_area = Watch(surface_area)  # graph output
code_block_26 = CodeBlock(x=maximum_stretch) { x*10; }
max_stretch = Watch(code_block_26)  # graph output
